# Grasshopper definition exampleDefinition.gh (Grasshopper 0.9.76)
# plug-ins: Tortuga

panel = Panel("C:\Users\MThumfart\Documents\GitHub\Tortuga\exampleData.csv")
material_editor = TortugaMaterialEditor(Path=panel, assembly="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")
srf4pt = _4PointSurface(
    CornerA=Point(-34.44993841, -7.851667919, 0),
    CornerB=Point(-13.31243044, 16.62132528, 0),
    CornerC=Point(-8.418830611, -31.57799658, 0),
    CornerD=Point(-25.5890345, -24.67278714, 0))
calculator = TortugaCalculator(Material=material_editor, Surface=srf4pt)
calculator_result = TortugaCalculatorResult(LCAResult=calculator)  # -> GlobalWarmingPotential, Acidification, DepletionOfNonrenewbles, DepletionOfOzoneLayer, Eutrophication, FormationTroposphericOzone
panel_2 = Panel([calculator_result.GlobalWarmingPotential, calculator_result.Acidification, calculator_result.DepletionOfNonrenewbles, calculator_result.DepletionOfOzoneLayer, calculator_result.Eutrophication, calculator_result.FormationTroposphericOzone])
